# Grasshopper definition LED_Dense.gh (Grasshopper 1.0.7)

zero = Panel("0,0,0")
crv = Curve(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)
line = LineSDL(Start=zero, Direction=Vector(0, 0, 1), Length=1)
cir = Circle(Plane=PlaneXY(0, 0, 0), Radius=Slider(30, range=0..30))
number_slider = Slider(40, range=0..66)
revsrf = Revolution(Curve=crv, Axis=line, Domain=Domain(0, 6.283185307))
divide = DivideCurve(Curve=cir, Count=100, Kinks=False)  # -> Points, Tangents, Parameters
sdivide = DivideSurface(Surface=revsrf, UCount=number_slider, VCount=number_slider)  # -> Points, Normals, Parameters
pdecon = Deconstruct(Point=divide.Points)  # -> XComponent, YComponent, ZComponent
number_slider_2 = Slider(4.569, range=0..12)
number_slider_3 = Slider(1.739, range=0..12)
number_slider_4 = Slider(5.895, range=0..12)
pdecon_2 = Deconstruct(Point=sdivide.Points)  # -> XComponent, YComponent, ZComponent
# curve
expression = Expression(
    x=pdecon.XComponent,
    y=pdecon.YComponent,
    a=number_slider_4,
    b=number_slider_2,
    c=number_slider_3,
    Expression="((x^2/a^2) - (y^2/b^2))/c")
# surface
expression_2 = Expression(
    x=pdecon_2.XComponent,
    y=pdecon_2.YComponent,
    a=number_slider_4,
    b=number_slider_2,
    c=number_slider_3,
    Expression="((x^2/a^2) - (y^2/b^2))/c")
panel = Panel("""-3
-7
-11
-15
-19
-23""")
panel_2 = Panel("""-1
-5
-9
-13
-17""")
pt = ConstructPoint(XCoordinate=pdecon.XComponent, YCoordinate=pdecon.YComponent, ZCoordinate=expression)  # -> flatten(Point)
pt_2 = ConstructPoint(XCoordinate=pdecon_2.XComponent, YCoordinate=pdecon_2.YComponent, ZCoordinate=expression_2)
intcrv = Interpolate(Vertices=pt, Degree=3, Periodic=True, KnotStyle=1)  # -> Curve, Length, Domain
flatten = FlattenTree(Tree=pt_2, Path="{0}")
item = ListItem(List=pt_2, Index=panel_2, Wrap=True)
item_2 = ListItem(List=pt_2, Index=panel, Wrap=True)
panel_3 = Panel(intcrv.Curve)
srfgrid = SurfaceFromPoints(Points=flatten, UCount=expr("x+1", number_slider), Interpolate=False)  # disabled
# key dimension:
# 
# 7in radius
# d=14in (355.6mm)
# fold 3/8" (9.525mm)
# 9circles
# 33mm -> center to center of LED
# 1m long LED strip, 30 light
# relaxed width 7in
panel_4 = Panel("""Isla's quick sketch modification
20210627""")
cir_2 = Circle(Plane="0,0,10", Radius="3")
cir_3 = Circle(Plane="0,0,-50", Radius="10")
crv_cp = CurveClosestPoint(Point=item, Curve=cir_2)  # -> Point, Parameter, Distance
crv_cp_2 = CurveClosestPoint(Point=item_2, Curve=cir_3)  # -> Point, Parameter, Distance
vec2pt = Vector2Pt(PointA=item, PointB=crv_cp.Point, Unitize=False)  # -> Vector, Length
vec2pt_2 = Vector2Pt(PointA=item_2, PointB=crv_cp_2.Point, Unitize=False)  # -> Vector, Length
unit = UnitVector(Vector=vec2pt.Vector)
unit_2 = UnitVector(Vector=vec2pt_2.Vector)
amp = Amplitude(Vector=unit, Amplitude="3")
amp_2 = Amplitude(Vector=unit_2, Amplitude="3")
move = Move(Geometry=item, Motion=amp)  # -> Geometry, Transform
move_2 = Move(Geometry=item_2, Motion=amp_2)  # -> Geometry, Transform
flip = FlipMatrix(Data=move.Geometry)
flip_2 = FlipMatrix(Data=move_2.Geometry)
pline = PolyLine(Vertices=flip, Closed=False)
pline_2 = PolyLine(Vertices=flip_2, Closed=False)
cull_i = CullIndex(List=flatten(pline), Indices="0", Wrap=True)
flatten_2 = FlattenTree(Tree=pline_2, Path="{0}")
weave = Weave(Pattern=[0, 1], Stream0=flatten_2, Stream1=flatten(pline), NullGaps=False)
scale = Scale(Geometry=weave, Center=Point(0, 0, 0), Factor="3.9")  # -> Geometry, Transform
loft = Loft(Curves=scale.Geometry, Options={Adjust=False, Closed=False, LoftEnds=0, LoftSimp=2, LoftType=3, Rebuild=10, Refit=0.01})
item_3 = ListItem(List=scale.Geometry, Index=0, Wrap=True)
len = Length(Curve=item_3)
panel_5 = Panel("""355.6mm = 14in
--> 1117.15mm""")
panel_6 = Panel(len)
item_4 = ListItem(List=scale.Geometry, Index="7", Wrap=True)
item_5 = ListItem(List=scale.Geometry, Index="8", Wrap=True)
item_6 = ListItem(List=scale.Geometry, Index="9", Wrap=True)
item_7 = ListItem(List=scale.Geometry, Index="10", Wrap=True)
item_8 = ListItem(List=scale.Geometry, Index="1", Wrap=True)
item_9 = ListItem(List=scale.Geometry, Index="2", Wrap=True)
item_10 = ListItem(List=scale.Geometry, Index="3", Wrap=True)
item_11 = ListItem(List=scale.Geometry, Index="4", Wrap=True)
item_12 = ListItem(List=scale.Geometry, Index="5", Wrap=True)
item_13 = ListItem(List=scale.Geometry, Index="6", Wrap=True)
tweencrv = TweenCurve(CurveA=item_4, CurveB=item_5, Factor=0.5, BlendType=0)
len_2 = Length(Curve=tweencrv)
tweencrv_2 = TweenCurve(CurveA=item_6, CurveB=item_7, Factor=0.5, BlendType=0)
len_3 = Length(Curve=tweencrv_2)
tweencrv_3 = TweenCurve(CurveA=item_8, CurveB=item_9, Factor=0.5, BlendType=0)
tweencrv_4 = TweenCurve(CurveA=item_10, CurveB=item_11, Factor=0.5, BlendType=0)
len_4 = Length(Curve=tweencrv_4)
tweencrv_5 = TweenCurve(CurveA=item_12, CurveB=item_13, Factor=0.5, BlendType=0)
len_5 = Length(Curve=tweencrv_5)
division = Division(A=len_2, B="7")
len_6 = Length(Curve=tweencrv_3)
division_2 = Division(A=len_3, B="7")
division_3 = Division(A=len_4, B="7")
division_4 = Division(A=len_5, B="7")
int = Integer(division)
division_5 = Division(A=len_6, B="7")
int_2 = Integer(division_2)
int_3 = Integer(division_3)
int_4 = Integer(division_4)
panel_7 = Panel("33")
int_5 = Integer(division_5)
series = Series(Start="0", Step="7", Count=int)
series_2 = Series(Start="0", Step="7", Count=int_2)
series_3 = Series(Start="0", Step="7", Count=int_5)
series_4 = Series(Start="0", Step="7", Count=int_3)
series_5 = Series(Start="0", Step="7", Count=int_4)
lng = ListLength(List=series_3)
eval = EvaluateLength(Curve=tweencrv, Length=series, Normalized=Toggle(False))  # -> Point, Tangent, Parameter
eval_2 = EvaluateLength(Curve=tweencrv_2, Length=series_2, Normalized=Toggle(False))  # -> Point, Tangent, Parameter
eval_3 = EvaluateLength(Curve=tweencrv_3, Length=series_3, Normalized=Toggle(False))  # -> Point, Tangent, Parameter
eval_4 = EvaluateLength(Curve=tweencrv_4, Length=series_4, Normalized=Toggle(False))  # -> Point, Tangent, Parameter
eval_5 = EvaluateLength(Curve=tweencrv_5, Length=series_5, Normalized=Toggle(False))  # -> Point, Tangent, Parameter
item_14 = ListItem(List=eval.Point, Index=0, Wrap=True)
item_15 = ListItem(List=eval_2.Point, Index=0, Wrap=True)
item_16 = ListItem(List=eval_3.Point, Index=0, Wrap=True)
item_17 = ListItem(List=eval_4.Point, Index=0, Wrap=True)
item_18 = ListItem(List=eval_5.Point, Index=0, Wrap=True)
sph = Sphere(Base=item_14, Radius=1)
sph_2 = Sphere(Base=item_15, Radius=1)
sph_3 = Sphere(Base=item_16, Radius=1)
sph_4 = Sphere(Base=item_17, Radius=1)
sph_5 = Sphere(Base=item_18, Radius=1)
addition = Addition(A=int_5)
# updated:
# 27 led in 1st ring
# 3 led in 2nd
# 30 total
total_number_of_led_light = Panel(addition)
# points to plug into the 2nd mapping export
merge = Merge(Data1=eval_3.Point, Data2=eval_4.Point, Data3=eval_5.Point, Data4=eval.Point, Data5=eval_2.Point)  # -> flatten(Result)
lng_2 = ListLength(List=merge)
panel_10 = Panel("7")
series_6 = Series(Start="0", Step=panel_10, Count=lng_2)
lng_3 = ListLength(List=merge)
X = UnitX(Factor=series_6)
panel_11 = Panel(lng_3)
points = PointList(Points=merge, Size="3")
# points to plug into the 3rd mapping export
move_3 = Move(Geometry="0,0,0", Motion=X)  # -> Geometry, Transform
points_2 = PointList(Points=move_3.Geometry, Size="3")
pline_3 = PolyLine(Vertices=move_3.Geometry, Closed=False)

# ---- group: external curve
crv_2 = Curve(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)
divide_2 = DivideCurve(Curve=crv_2, Count=Slider(30, range=0..100), Kinks=False)  # -> Points, Tangents, Parameters

# ----
pt_3 = Point(flatten(merge))
points_3 = PointList(Points=pt_3, Size=Slider(1, range=0..10))
item_19 = ListItem(List=pt_3, Index=Slider(60, range=0..100), Wrap=True)
pdecon_3 = Deconstruct(Point=pt_3)  # -> XComponent, YComponent, ZComponent
panel_12 = Panel(pdecon_3.ZComponent)
panel_13 = Panel(pdecon_3.YComponent)
format = Format(Format="[{0},{1},{2}]", Culture=127, Data0=pdecon_3.XComponent, Data1=pdecon_3.YComponent, Data2=pdecon_3.ZComponent)
panel_14 = Panel(format)
join = TextJoin(Text=panel_14, Join=",")
# 3D points// Exporting JSON file:
# Make sure you save the final panel into your code folder
panel_15 = Panel(join)
format_2 = Format(Format="[{0}]", Culture=127, Data0=panel_15)
panel_16 = Panel(format_2)

pt_4 = Point(move_3.Geometry)
points_4 = PointList(Points=pt_4, Size=Slider(1, range=0..10))
item_20 = ListItem(List=pt_4, Index=Slider(60, range=0..100), Wrap=True)
pdecon_4 = Deconstruct(Point=pt_4)  # -> XComponent, YComponent, ZComponent
panel_17 = Panel(pdecon_4.ZComponent)
panel_18 = Panel(pdecon_4.XComponent)
panel_19 = Panel(pdecon_4.YComponent)
format_3 = Format(Format="[{0},{1},{2}]", Culture=127, Data0=pdecon_4.XComponent, Data1=pdecon_4.YComponent, Data2=pdecon_4.ZComponent)
panel_20 = Panel(format_3)
join_2 = TextJoin(Text=panel_20, Join=",")
# Flat points// Exporting JSON file:
# Make sure you save the final panel into your code folder
panel_21 = Panel(join_2)
format_4 = Format(Format="[{0}]", Culture=127, Data0=panel_21)
panel_22 = Panel(format_4)

pt_5 = Point(flatten(divide_2.Points))
points_5 = PointList(Points=pt_5, Size=Slider(1, range=0..10))
pdecon_5 = Deconstruct(Point=pt_5)  # -> XComponent, YComponent, ZComponent
panel_23 = Panel(pdecon_5.ZComponent)
panel_24 = Panel(pdecon_5.YComponent)
format_5 = Format(Format="[{0},{1},{2}]", Culture=127, Data0=pdecon_5.XComponent, Data1=pdecon_5.YComponent, Data2=pdecon_5.ZComponent)
panel_25 = Panel(format_5)
join_3 = TextJoin(Text=panel_25, Join=",")
panel_26 = Panel(join_3)
format_6 = Format(Format="[{0}]", Culture=127, Data0=panel_26)
panel_27 = Panel(format_6)

panel_28 = Panel(pdecon_3.XComponent)
panel_29 = Panel(pdecon_5.XComponent)
